# Grasshopper definition GrasshopperScript.gh (Grasshopper 1.0.7)
# plug-ins: MeshEdit Components, Human, Kangaroo Components, Kangaroo2 Components

# ----
# Model 1
number_slider = Slider(1, range=0..1)
mesh_plane = MeshPlane(
    Boundary={Plane=PlaneXY(0, 0, 0), Size=Domain2(u=-10..10, v=-10..10)},
    WidthCount=number_slider,
    HeightCount=Slider(2, range=0..10))  # -> Mesh, Area
shell = Mesh(mesh_plane.Mesh)
refine = Refine(Mesh=shell, Level="0")
mesh = Mesh(refine)
clean = CombineClean(Meshes=mesh)
deconstruct_mesh = DeconstructMesh(Mesh=clean)  # -> Vertices, Faces, Colours, Normals
removeduplicatepts = RemoveDuplicatePts(Points=flatten(deconstruct_mesh.Vertices), Tolerance=0.01)
pdecon = Deconstruct(Point=removeduplicatepts)  # -> XComponent, YComponent, ZComponent
explode = MeshExplode(Mesh=clean, Interpolate=False)  # -> flatten(Faces)
smaller_than = SmallerThan(FirstNumber=pdecon.XComponent, SecondNumber=Slider(0.01, range=0..0.01))  # -> SmallerThan, OrEqualTo
dispatch = Dispatch(List=removeduplicatepts, DispatchPattern=smaller_than.OrEqualTo)  # -> ListA, ListB
vec = VectorXYZ(XComponent=Slider(17, range=-20..20), YComponent=Slider(20, range=-20..20), ZComponent=Slider(-100, range=-100..20))  # -> Vector, Length
pointload = Point(dispatch.ListB)
support = Point(dispatch.ListA)
entwine = Entwine(Branch00=explode, Branch03=support, Branch04=pointload, Branch05=vec.Vector, FlattenInputs=True)

# ----
# Model 0
number_slider_2 = Slider(-20, range=-20..20)
pointload_2 = Point([Point(0, 0, 10), Point(5, 0, 10), Point(0, 5, 5), Point(0, 5, 10), Point(0, 0, 5)])
vec_2 = VectorXYZ(XComponent=number_slider_2, YComponent=0, ZComponent=0)  # -> Vector, Length
support_2 = Point([Point(0, 0, 0), Point(5, 0, 0), Point(10, 0, 0), Point(15, 0, 0), Point(15, 5, 0), Point(10, 5, 0), Point(5, 5, 0), Point(0, 5, 0)])
shell_2 = Mesh([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])
beam = Curve([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])
truss = Curve([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])
vec_3 = VectorXYZ(XComponent=Slider(0, range=-20..20), YComponent=0, ZComponent=0)  # -> Vector, Length
vec_4 = VectorXYZ(XComponent=0, YComponent=Slider(11, range=-20..20), ZComponent=0)  # -> Vector, Length
cantiliver = Curve([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])
columns = Curve([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])
refine_2 = Refine(Mesh=shell_2, Level="2")
mesh_2 = Mesh(refine_2)
clean_2 = CombineClean(Meshes=mesh_2)
explode_2 = MeshExplode(Mesh=clean_2, Interpolate=False)  # -> flatten(Faces)
entwine_2 = Entwine(
    Branch00=explode_2,
    Branch01=beam,
    Branch02=truss,
    Branch03=support_2,
    Branch04=pointload_2,
    Branch05=vec_2.Vector,
    Branch06=columns,
    Branch07=vec_3.Vector,
    Branch08=cantiliver,
    Branch09=vec_4.Vector,
    FlattenInputs=True)

# ----
# Model 2
number_slider_3 = Slider(6, range=0..10)
vector_xyz = VectorXYZ(XComponent=0, YComponent=0, ZComponent=0)  # -> Vector, Length
vector_xyz_2 = VectorXYZ(XComponent=0, YComponent=0, ZComponent=number_slider_3)  # -> Vector, Length
move = Move(Geometry=vector_xyz.Vector, Motion=vector_xyz_2.Vector)  # -> Geometry, Transform
line = Line(StartPoint=vector_xyz.Vector, EndPoint=move.Geometry)
num = Number("10000")
pointload_3 = Point(move.Geometry)
vec_5 = VectorXYZ(XComponent=0, YComponent=Slider(6, range=-20..20), ZComponent=0)  # -> Vector, Length
pointload_4 = Point(move.Geometry)
support_3 = Point(vector_xyz.Vector)
vec_6 = VectorXYZ(XComponent=Slider(0, range=-20..20), YComponent=0, ZComponent=0)  # -> Vector, Length
beam_2 = Curve(line)
columns_2 = Curve(beam_2)
entwine_3 = Entwine(
    Branch01=beam_2,
    Branch03=support_3,
    Branch04=pointload_4,
    Branch05=vec_5.Vector,
    Branch06=columns_2,
    Branch07=vec_6.Vector,
    Branch010=pointload_3,
    Branch011=num,
    FlattenInputs=True)

# ---- group: Element
data = Data(0)
data_2 = Data(0)

# ---- group: Load
data_3 = Data(0)
data_4 = Data(0)

# ---- group: Cross-Section
data_5 = Data(0)
data_6 = Data(0)

# ---- group: Support
data_7 = Data(0)
data_8 = Data(0)

# ---- group: Material
data_9 = Data(0)
data_10 = Data(0)

# ---- group: Constraint
data_11 = Data(0)
data_12 = Data(0)

# ----
list = ValueList({"Building": 0, "Shell": 1, "Cantiliver": 2}, selected="Cantiliver")
custom_preview = CustomPreview(Geometry=support_2, Material=ColourSwatch(SwatchColor=RGB(0, 0, 0)))
stream_filter = StreamFilter(Gate=list, Stream0=entwine_2, Stream1=entwine, Stream2=entwine_3)
explode_tree = ExplodeTree(Data=stream_filter)  # -> Branch0, Branch1, Branch2, Branch3, Branch4, Branch5, Branch6, Branch7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

pointload_5 = Point(explode_tree.Branch4)
vector = Data(explode_tree.Branch5)

support_4 = Point(explode_tree.Branch3)
shell_3 = Mesh(explode_tree.Branch0)
beam_3 = Curve(explode_tree.Branch1)
truss_2 = Curve(explode_tree.Branch2)

data_13 = Data(explode_tree.Branch6)
vector_2 = Data(explode_tree.Branch7)

data_14 = Data(explode_tree.Branch8)
vector_3 = Data(explode_tree.Branch9)

data_15 = Data(explode_tree.Branch10)
mass = Data(explode_tree.Branch11)

# ----
# UniaxialMaterial
# Elastic
file_path = FilePath("C:\GitHub\Alpaca4d\PythonScript\Pre-Processing\Material\uniAxialMaterial\ElasticUniaxialMaterial.py")
read_file = ReadFile(File=file_path, PerLineParse=False)
python = GhPythonScript(Code=read_file, MatName="S275", E="210000", G="80760", Rho="75", Fy="35")  # -> Out, ElasticMaterialWrapper
python_2 = GhPythonScript(x=python.ElasticMaterialWrapper)  # -> out, a
# ---------- python_2: Python ----------
a = x
# ---------- end python_2 ----------
panel = Panel(python_2.a)

# ----
# UniaxialMaterial
# Elastic
panel_2 = Panel("210000")
python_3 = GhPythonScript(Code=read_file, MatName="S255", E=panel_2, G="80760", Rho="75", Fy="25")  # -> Out, ElasticMaterialWrapper
python_4 = GhPythonScript(x=python_3.ElasticMaterialWrapper)  # -> out, a; same code as python_2
panel_3 = Panel(python_4.a)

# ----
# nDMaterial
# ElasticIsotropic
file_path_2 = FilePath("C:\GitHub\Alpaca4d\PythonScript\Pre-Processing\Material\nDMaterial\ElasticIsotropic.py")
read_file_2 = ReadFile(File=file_path_2, PerLineParse=False)
python_5 = GhPythonScript(Code=read_file_2, MatName="S275", E="210000", G="80760", Rho="75", Fy="35")  # -> Out, ElasticMaterialWrapper

# ----
# Support
file_path_3 = FilePath("C:\GitHub\Alpaca4d\PythonScript\Pre-Processing\Element\Support\Support.py")
toggle = BooleanToggle(True)
read_file_3 = ReadFile(File=file_path_3, PerLineParse=False)
point = Point(support_4)
python_6 = GhPythonScript(Code=read_file_3, Pos=graft(point), Tx=toggle, Ty=Toggle(True), Tz=toggle, Rx=toggle, Ry=toggle, Rz=toggle)  # -> Out, flatten(SupportWrapper)
python_7 = GhPythonScript(x=python_6.SupportWrapper)  # -> out, a; same code as python_2
panel_4 = Panel(python_7.a)

# ----
# Circular CrossSection
file_path_4 = FilePath("C:\GitHub\Alpaca4d\PythonScript\Pre-Processing\Section\CircularCrossSection.py")
read_file_4 = ReadFile(File=file_path_4, PerLineParse=False)
python_8 = GhPythonScript(Code=read_file_4, SectionName="CHS", Diameter="300", Thickness="150", Material=python_3.ElasticMaterialWrapper)  # -> Out, CircleCrossSection

# ----
# Elastic Membrane Plate Section
file_path_5 = FilePath("C:\GitHub\Alpaca4d\PythonScript\Pre-Processing\Section\ElasticMembranePlateSection.py")
read_file_5 = ReadFile(File=file_path_5, PerLineParse=False)
python_9 = GhPythonScript(Code=read_file_5, SectionName="concreteSlab", Thickness="200", Material=python_5.ElasticMaterialWrapper)  # -> Out, PlateFiberSection

# ----
# Rectangular Cross Section
file_path_6 = FilePath("C:\GitHub\Alpaca4d\PythonScript\Pre-Processing\Section\RectangularCrossSection.py")
read_file_6 = ReadFile(File=file_path_6, PerLineParse=False)
python_10 = GhPythonScript(Code=read_file_6, SectionName="RHS", Base="300", Height="300", Material=python.ElasticMaterialWrapper)  # -> Out, RectangularCrossSection

# ----
# Point Load
file_path_7 = FilePath("C:\GitHub\Alpaca4d\PythonScript\Pre-Processing\Load\PointLoad.py")
read_file_7 = ReadFile(File=file_path_7, PerLineParse=False)
vector_4 = Vector(expr("x*0", Vector(2.518385542, -6.656153768, 0)))
vector_5 = Vector(vector)
point_2 = Point(pointload_5)
python_11 = GhPythonScript(Code=read_file_7, Force=vector_5, Moment=vector_4, Pos=point_2)  # -> Out, flatten(LoadWrapper)

# ----
# WIP
panel_5 = Panel("100")
random = Random(Range="20", Number=panel_5, Seed=2)
random_2 = Random(Range="20", Number=panel_5, Seed="3")
pt = ConstructPoint(XCoordinate=random, YCoordinate=random_2, ZCoordinate=0)
python_12 = GhPythonScript(Pos=pt, RigidDiaphragm=Toggle(True))  # -> Out, A

# ----
# Generic Cross Section
file_path_8 = FilePath("C:\GitHub\Alpaca4d\PythonScript\Pre-Processing\Section\GenericCrossSection.py")
read_file_8 = ReadFile(File=file_path_8, PerLineParse=False)
python_13 = GhPythonScript(
    Code=read_file_8,
    SectionName="Generic",
    Area="20",
    Ay="20",
    Az="20",
    Iyy="20",
    Izz="20",
    J="20",
    Material=python.ElasticMaterialWrapper)  # -> Out, GenericCrossSection

# ----
# MassLoad
num_2 = Number(mass)
path = FilePath("C:\GitHub\Alpaca4d\PythonScript\Pre-Processing\Load\MassLoad.py")
pt_2 = Point(data_15)
file = ReadFile(File=path, PerLineParse=False)
python_14 = GhPythonScript(Code=file, NodalMassTranslation=num_2, Pos=pt_2)  # -> Out, flatten(Mass)

file_path_9 = FilePath("C:\GitHub\Alpaca4d\PythonScript\Pre-Processing\Load\BeamLoad.py")
read_file_9 = ReadFile(File=file_path_9, PerLineParse=False)

# ----
# Linear Load
value_list = ValueList({"LocalAxis": 0, "GlobalAxis": 1}, selected="GlobalAxis")
crv = Curve(data_13)
vector_6 = Vector(vector_2)
python_15 = GhPythonScript(Code=read_file_9, Force=vector_6, Element=crv, Orientation=value_list)  # -> Out, flatten(BeamUniformLoad)

# ----
# Linear Load
value_list_2 = ValueList({"LocalAxis": 0, "GlobalAxis": 1}, selected="GlobalAxis")
vector_7 = Vector(vector_3)
crv_2 = Curve(data_14)
python_16 = GhPythonScript(Code=read_file_9, Force=vector_7, Element=crv_2, Orientation=value_list_2)  # -> Out, flatten(BeamUniformLoad)

# ----
# meshToShell
mesh_3 = Mesh(shell_3)
file_path_10 = FilePath("C:\GitHub\Alpaca4d\PythonScript\Pre-Processing\Element\MeshToShell\MeshToShell.py")
read_file_10 = ReadFile(File=file_path_10, PerLineParse=False)
python_17 = GhPythonScript(
    Code=read_file_10,
    Mesh=mesh_3,
    Colour=ColourSwatch(SwatchColor=RGB(0, 72, 255)),
    CrossSection=python_9.PlateFiberSection)  # -> Out, flatten(ShellWrapper)

# ----
# LineToBeam
file_path_11 = FilePath("C:\GitHub\Alpaca4d\PythonScript\Pre-Processing\Element\LineToBeam\LineToBeam.py")
read_file_11 = ReadFile(File=file_path_11, PerLineParse=False)
list_2 = ValueList({"Truss": 0, "Beam": 1}, selected="Beam")
crv_3 = Curve(beam_3)
python_18 = GhPythonScript(
    Code=read_file_11,
    Line=crv_3,
    Colour=ColourSwatch(SwatchColor=RGB(34, 255, 0)),
    CrossSection=python_8.CircleCrossSection,
    OrientSection="0",
    BeamType=list_2)  # -> Out, flatten(BeamWrapper)

crv_4 = Curve(truss_2)

data_16 = Data([python_15.BeamUniformLoad, python_16.BeamUniformLoad, python_11.LoadWrapper])

# ----
# LineToTruss
list_3 = ValueList({"Truss": 0, "Beam": 1}, selected="Truss")
python_19 = GhPythonScript(
    Code=read_file_11,
    Line=crv_4,
    Colour=ColourSwatch(SwatchColor=RGB(255, 200, 0)),
    CrossSection=python_8.CircleCrossSection,
    OrientSection="0",
    BeamType=list_3)  # -> Out, flatten(BeamWrapper)

merge = Merge(Data1=python_17.ShellWrapper, Data2=python_18.BeamWrapper, Data3=python_19.BeamWrapper)

# ----
# visualizeTimeDeformation per Time History
toggle_2 = BooleanToggle(False)
python_20 = GhPythonScript(Reset=Button(), Run=toggle_2)  # -> out, b; inputs Reset: Boolean
# ---------- python_20: Python ----------
import Grasshopper as gh
import Rhino.Geometry as rg

def updateComponent(interval):
    
    """ Updates this component, similar to using a grasshopper timer """
    
    # Define callback action
    def callBack(e):
        ghenv.Component.ExpireSolution(False)
        
    # Get grasshopper document
    ghDoc = ghenv.Component.OnPingDocument()
    
    # Schedule this component to expire
    ghDoc.ScheduleSolution(interval,gh.Kernel.GH_Document.GH_ScheduleDelegate(callBack)) # Note that the first input here is how often to update the component (in milliseconds)


time = []
displacement = []

# text file with the displacement output as per ops.record()

with open(r"C:\Users\FORMAT\Desktop\New folder\DFree.out", 'r') as f:
    lines = f.readlines()
    for n, line in enumerate(lines):
        if (n % 10) == 0:
            line = line.strip().split(" ")
            time.append( line[0] )
            displacementTemp = line[1:]
            n = 6
            displacementTime = [displacementTemp[i:i + n] for i in range(0, len(displacementTemp), n)]
            displacement.append(displacementTime)


b = []

if "m" not in globals() or Reset:
    m = 0

if Run and not Reset:
    m += 1
    updateComponent(1)

for vector in displacement[m]:
    b.append( rg.Vector3d(float(vector[0]), float(vector[1]), float(vector[2]) ) )
# ---------- end python_20 ----------
panel_6 = Panel(python_20.b)
vec_7 = Vector(python_20.b)
multiplication = Multiplication(A=vec_7, B=Slider(34.04, range=-10..200))
move_2 = Move(Motion=multiplication)  # -> Geometry, Transform

# ----
# have a look
toggle_3 = BooleanToggle(False)
python_21 = GhPythonScript(Reset=Button(), Run=toggle_3)  # -> out, b; inputs Reset: Boolean
# ---------- python_21: Python ----------
import Grasshopper as gh
import Rhino.Geometry as rg

def updateComponent(interval):
    
    """ Updates this component, similar to using a grasshopper timer """
    
    # Define callback action
    def callBack(e):
        ghenv.Component.ExpireSolution(False)
        
    # Get grasshopper document
    ghDoc = ghenv.Component.OnPingDocument()
    
    # Schedule this component to expire
    ghDoc.ScheduleSolution(interval,gh.Kernel.GH_Document.GH_ScheduleDelegate(callBack)) # Note that the first input here is how often to update the component (in milliseconds)


time = []
displacement = []




b = []

if "m" not in globals() or Reset:
    m = 0

if Run and not Reset:
    m += 1
    print(m)
    updateComponent(1)

"""
for vector in displacement[m]:
    b.append( rg.Vector3d(float(vector[0]), float(vector[1]), float(vector[2]) ) )
"""
# ---------- end python_21 ----------
panel_7 = Panel(python_21.b)
vec_8 = Vector(python_21.b)
multiplication_2 = Multiplication(A=vec_8, B=Slider(34.04, range=-10..200))
move_3 = Move(Motion=multiplication_2)  # -> Geometry, Transform

# ----
# Assemble
file_path_12 = FilePath("C:\GitHub\Alpaca4d\PythonScript\Pre-Processing\Assemble\Assemble.py")
read_file_12 = ReadFile(File=file_path_12, PerLineParse=False)
python_22 = GhPythonScript(
    Code=read_file_12,
    Element=flatten(merge),
    Support=flatten(python_6.SupportWrapper),
    Load=flatten(data_16),
    Mass=flatten(python_14.Mass))  # -> Out, OpenSeesModel

# ----
# modelView
# da fare a cluster
file_path_13 = FilePath("C:\GitHub\Alpaca4d\PythonScript\Post-Processing\modelView\modelView.py")
read_file_13 = ReadFile(File=file_path_13, PerLineParse=False)
python_23 = GhPythonScript(
    Code=read_file_13,
    OpenSeesModel=python_22.OpenSeesModel,
    ModelExstrud=Toggle(False),
    Load=Toggle(False),
    Support=Toggle(False),
    LocalAxes=Toggle(False),
    NodeTag=Toggle(False),
    ElementTag=Toggle(False))  # -> ModelView, LineModel, ForceDisplay, Support, LocalAxis, TagNode, TagEle
modelview = ModelView(python_23.ModelView)
explode_tree_2 = ExplodeTree(Data=python_23.LocalAxis)  # -> Branch0, Branch1, Branch2, Branch3
explode_tree_3 = ExplodeTree(Data=python_23.LineModel)  # -> Branch0, Branch1
explode_tree_4 = ExplodeTree(Data=simplify(python_23.TagNode))  # -> Branch0, Branch1
explode_tree_5 = ExplodeTree(Data=simplify(python_23.TagEle))  # -> Branch0, Branch1
explode_tree_6 = ExplodeTree(Data=python_23.ForceDisplay)  # -> Branch0, Branch1
curve_direction = GhPythonScript(Crv=explode_tree_3.Branch0, Thickness=Slider(3, range=0..10), RGB=explode_tree_3.Branch1)  # -> out; inputs Crv: list of Curve, RGB: list of Color
# ---------- curve_direction: Python ----------
from ghpythonlib.componentbase import executingcomponent as component
import Grasshopper, GhPython
import System
import Rhino as rh
import rhinoscriptsyntax as rs
import Rhino.Geometry as rg


class CurveColor(component):

    def RunScript(self,Crv,Thickness,RGB):
        self.C = Crv
        self.RGB = RGB
        self.t = Thickness
        if not self.C: return
            
    def DrawViewportWires(self,arg):
        if not  self.C: return
        for curve, color in zip( self.C, self.RGB ):
            arg.Display.DrawCurve(curve, color,self.t)
# ---------- end curve_direction ----------
custom_preview_2 = CustomPreview(Geometry=python_23.Support, Material=ColourSwatch(SwatchColor=RGB(164, 252, 0)))
vector_display_ex = VectorDisplayEx(Point=explode_tree_6.Branch0, Vector=explode_tree_6.Branch1, Colour=ColourSwatch(SwatchColor=RGB(176, 32, 32)), Width=2)
vector_display_ex_2 = VectorDisplayEx(Point=explode_tree_2.Branch0, Vector=explode_tree_2.Branch1, Colour=ColourSwatch(SwatchColor=RGB(252, 0, 0)), Width=2)
vector_display_ex_3 = VectorDisplayEx(Point=explode_tree_2.Branch0, Vector=explode_tree_2.Branch2, Colour=ColourSwatch(SwatchColor=RGB(0, 245, 53)), Width=2)
vector_display_ex_4 = VectorDisplayEx(Point=explode_tree_2.Branch0, Vector=explode_tree_2.Branch3, Colour=ColourSwatch(SwatchColor=RGB(0, 55, 255)), Width=2)
tag = TextTag(Location=explode_tree_4.Branch0, Text=explode_tree_4.Branch1, Colour=ColourSwatch(SwatchColor=RGB(255, 0, 0)))
tag_2 = TextTag(Location=explode_tree_5.Branch0, Text=explode_tree_5.Branch1, Colour=ColourSwatch(SwatchColor=RGB(25, 0, 255)))

file_path_14 = FilePath("C:\GitHub\Alpaca4d\PythonScript\Post-Processing\disassembleModel\disassembleModel.py")
path_2 = FilePath("C:\GitHub\Alpaca4d\PythonScript\Analyses\LinearAnalyses\initializeAnalysis.py")
read_file_14 = ReadFile(File=file_path_14, PerLineParse=False)
path_3 = FilePath("C:\GitHub\Alpaca4d\PythonScript\Analyses\openSees_StaticSolver_3ndf\initializeAnalysis_3ndf.py")

# ----
# EarthQuake Analyses
path_4 = FilePath("C:\GitHub\Alpaca4d\PythonScript\Analyses\EarthQuakeAnalysis\BM68elc.acc")
path_5 = FilePath("C:\GitHub\Alpaca4d\PythonScript\Analyses\EarthQuakeAnalysis\initializeEarthQuakeAnalysis.py")
list_4 = ValueList({"x": 1, "y": 2, "z": 3}, selected="x")
file_2 = ReadFile(File=path_5, PerLineParse=False)
analyze = GhPythonScript(
    Code=file_2,
    OpenSeesModel=python_22.OpenSeesModel,
    TmaxAnalyses="50",
    GroundMotionDirection=list_4,
    GroundMotionFile=path_4,
    GroundMotionTimeStep="0.01",
    GroundMotionfactor="100",
    Damping=0.02,
    NewmarkGamma=0.5,
    NewmarkBeta=0.25)  # -> Out, OpenSeesOutputWrapper, MaxDisplacement, MinDisplacement

file_3 = ReadFile(File=path_4, PerLineParse=False)
split = TextSplit(Text=file_3, Separators=" ")
division = Division(A=split, B="1")
clean_3 = CleanTree(RemoveNulls=True, RemoveInvalid=True, RemoveEmpty=invert(False), Tree=division)
graph = QuickGraph(clean_3, SortOrder=0)
lng = ListLength(List=clean_3)
multiplication_3 = Multiplication(A=lng, B="0.01")
earthquake_file_seconds = Panel(multiplication_3)

# ----
# Modal Analyses
path_6 = FilePath("C:\GitHub\Alpaca4d\PythonScript\Analyses\DynamicAnalysis\initializeModalAnalyses.py")
file_4 = ReadFile(File=path_6, PerLineParse=False)
analyze_2 = GhPythonScript(Code=file_4, OpenSeesModel=python_22.OpenSeesModel, NumEigenvalues="3")  # -> Out, OpenSeesOutputWrapper, Frequency, Period
panel_8 = Panel(analyze_2.Frequency)

# ----
# solver on folder Static Analyses
file_5 = ReadFile(File=path_2, PerLineParse=False)
# solver on folder Static Analyses 3ndf
file_6 = ReadFile(File=path_3, PerLineParse=False)

# ---- group: disassemble Model
python_24 = GhPythonScript(Code=read_file_14, OpenSeesModel=python_22.OpenSeesModel)  # -> Out, ModelView, ModelViewExtruded, Points, Support, Load, Material, Section

# ----
analyze_3 = GhPythonScript(Code=file_5, OpenSeesModel=python_22.OpenSeesModel)  # -> Out, OpenSeesOutputWrapper
analyze_4 = GhPythonScript(Code=file_6, OpenSeesModel=python_22.OpenSeesModel)  # -> Out, OpenSeesOutputWrapper
panel_9 = Panel(analyze.MinDisplacement)
panel_10 = Panel(analyze.MaxDisplacement)

# ---- group: Cds Visualisation
number_slider_4 = Slider(0.184, range=0.001..10)
file_path_15 = FilePath("C:\GitHub\Alpaca4d\PythonScript\Post-Processing\cdsView\cdsView.py")
read_file_15 = ReadFile(File=file_path_15, PerLineParse=False)
list_5 = ValueList({"N": 0, "V1": 1, "V2": 2, "M2": 3, "M1": 4, "Mt": 5}, selected="N")
python_25 = GhPythonScript(Code=read_file_15, OpenSeesOutputWrapper=analyze_3.OpenSeesOutputWrapper, Cds=list_5)

# ----
file_path_16 = FilePath("C:\GitHub\Alpaca4d\PythonScript\Post-Processing\shellForceView\shellForceView.py")

# ---- group: Beam Forces
file_path_17 = FilePath("C:\GitHub\Alpaca4d\PythonScript\Post-Processing\beamForces\beamForces.py")
read_file_16 = ReadFile(File=file_path_17, PerLineParse=False)
python_26 = GhPythonScript(Code=read_file_16, OpenSeesOutputWrapper=analyze_3.OpenSeesOutputWrapper, NumberResults=Slider(10, range=0..10))  # -> Out, TagElement, N, V1, V2, Mt, M1, M2
panel_11 = Panel(python_26.TagElement)

# ---- group: tension Visualisation
# nel shellForce avremo la mesh del diagramma che visualizziamo
# magari in questo posso mettere anche gli element brick ( se hanno le forze )
list_6 = ValueList({"sigmaX": 0, "sigmaY": 1, "sigmaZ": 2, "tauXY": 3, "tauYZ": 4, "tauXZ": 5, "mx": 6, "my": 7}, selected="sigmaX")
python_27 = GhPythonScript(ViewForce=list_6)

# ----
read_file_17 = ReadFile(File=file_path_16, PerLineParse=False)

# ---- group: Reaction Forces
file_path_18 = FilePath("C:\GitHub\Alpaca4d\PythonScript\Post-Processing\reaction\reaction.py")
read_file_18 = ReadFile(File=file_path_18, PerLineParse=False)
# Force component
python_28 = GhPythonScript(
    Code=read_file_18,
    OpenSeesOutputWrapper=analyze_3.OpenSeesOutputWrapper,
    ReactionMomentsView=Toggle(False),
    ReactionForcesView=Toggle(True))  # -> Out, TagPoints, ReactionForces, ReactionMoments, View
tagpoints = TagPoints(python_28.TagPoints)
reactionforces = ReactionForces(python_28.ReactionForces)
reactionmoments = ReactionMoments(python_28.ReactionMoments)
explode_tree_7 = ExplodeTree(Data=python_28.View)  # -> Branch0, Branch1, Branch2, Branch3
vector_display = VectorDisplay(Anchor=explode_tree_7.Branch0, Vector=[explode_tree_7.Branch1, explode_tree_7.Branch2, explode_tree_7.Branch3])

# ---- group: shell Forces
file_path_19 = FilePath("C:\GitHub\Alpaca4d\PythonScript\Post-Processing\shellForces\shellForces.py")
read_file_19 = ReadFile(File=file_path_19, PerLineParse=False)
python_29 = GhPythonScript(Code=read_file_19, OpenSeesOutputWrapper=analyze_3.OpenSeesOutputWrapper)  # -> Out, TagElement, Fx, Fy, Fz, Mx, My, Mz
panel_12 = Panel(python_29.Fx)

# ---- group: nD Force Visualisation
list_7 = ValueList({"Fx": 0, "Fy": 1, "Fz": 2, "Mx": 3, "My": 4, "Mz": 5}, selected="Mx")
python_30 = GhPythonScript(Code=read_file_17, OpenSeesOutputWrapper=analyze_3.OpenSeesOutputWrapper, ViewForce=list_7)  # -> ModelForce, ForceValue

# ----
# Numerical Ouput
number_slider_5 = Slider(10, range=0..10)
file_path_20 = FilePath("C:\GitHub\Alpaca4d\PythonScript\Post-Processing\beamDisp\beamDisp.py")
file_path_21 = FilePath("C:\GitHub\Alpaca4d\PythonScript\Post-Processing\shellDisp\shellDisp.py")
file_path_22 = FilePath("C:\GitHub\Alpaca4d\PythonScript\Post-Processing\nodalDisp\nodalDisp.py")
file_path_23 = FilePath("C:\GitHub\Alpaca4d\PythonScript\Post-Processing\brickDisp\brickDisp.py")
read_file_20 = ReadFile(File=file_path_20, PerLineParse=False)
read_file_21 = ReadFile(File=file_path_21, PerLineParse=False)
read_file_22 = ReadFile(File=file_path_22, PerLineParse=False)
read_file_23 = ReadFile(File=file_path_23, PerLineParse=False)

file_path_24 = FilePath("C:\GitHub\Alpaca4d\PythonScript\Post-Processing\defModelView\defModelView.py")
read_file_24 = ReadFile(File=file_path_24, PerLineParse=False)

# ---- group: brick Displacement
python_31 = GhPythonScript(Code=read_file_23, OpenSeesOutputWrapper=analyze_3.OpenSeesOutputWrapper)  # -> Out, TagElement, Trans

# ---- group: Beam Displacement
python_32 = GhPythonScript(Code=read_file_20, OpenSeesOutputWrapper=analyze_3.OpenSeesOutputWrapper, NumberResults=number_slider_5)  # -> Out, TagElement, LocalTrans, LocalRot, GlobalTrans, GlobalRot

# ----
path_7 = FilePath("C:\GitHub\Alpaca4d\PythonScript\Post-Processing\viewGroundAccAnalyses\viewGroundAccAnalyses.py")

# ---- group: Shell Displacement
python_33 = GhPythonScript(Code=read_file_21, OpenSeesOutputWrapper=analyze_3.OpenSeesOutputWrapper)  # -> Out, TagElement, Trans, Rot

# ---- group: Displacement Nodes
python_34 = GhPythonScript(Code=read_file_22, OpenSeesOutputWrapper=analyze_3.OpenSeesOutputWrapper)  # -> Out, Points, Trans, Rot

# ----
file_7 = ReadFile(File=path_7, PerLineParse=False)

# ---- group: Legend Display
number_slider_6 = Slider(10, range=0..10)
number_slider_7 = Slider(35, range=0..1000)
number_slider_8 = Slider(655, range=0..1000)

# ----
# deformedModelView
number_slider_9 = Slider(0, range=0..10000)
list_8 = ValueList({"tx": 0, "ty": 1, "tz": 2}, selected="ty")
python_35 = GhPythonScript(
    Code=read_file_24,
    OpenSeesOutputWrapper=analyze_3.OpenSeesOutputWrapper,
    Direction=list_8,
    Scale=number_slider_9,
    ModelExstrud=Toggle(False))  # -> Out, ModelDisp, ModelCurve, Max_min
modeldisp = ModelDisp(python_35.ModelDisp)
max_min = Max_min(python_35.Max_min)
explode_tree_8 = ExplodeTree(Data=python_35.ModelCurve)  # -> Branch0, Branch1, Branch2
list_item = ListItem(List=python_35.Max_min, Index=0, Wrap=True)  # -> Item, Item1
construct_domain = ConstructDomain(DomainStart=list_item.Item1, DomainEnd=list_item.Item)
divide_curve = DivideCurve(Curve=explode_tree_8.Branch0, Count=explode_tree_8.Branch1, Kinks=False)  # -> Points, Tangents, simplify(Parameters)
dedomain = DeconstructDomain(Domain=construct_domain)  # -> Start, End
shatter = Shatter(Curve=graft(explode_tree_8.Branch0), Parameters=divide_curve.Parameters)  # -> simplify(Segments)
ghpython_script = GhPythonScript(max=dedomain.End, min=dedomain.Start)  # -> out, color, tag, domain
# ---------- ghpython_script: Python ----------
import Rhino.Geometry as rg
import ghpythonlib.components as ghcomp
import math as mt
import ghpythonlib.treehelpers as th # per data tree
import Grasshopper
#import System as sy #DV
import sys
import rhinoscriptsyntax as rs

'''
ghFilePath = ghenv.LocalScope.ghdoc.Path
ghFileName = ghenv.LocalScope.ghdoc.Name
folderNameLength = len(ghFilePath)-len(ghFileName)-2 #have to remove '.gh'
ghFolderPath = ghFilePath[0:folderNameLength]

outputPath = ghFolderPath + 'assembleData'
wrapperFile = ghFolderPath + 'assembleData\\openSeesModel.txt'

userObjectFolder = Grasshopper.Folders.DefaultUserObjectFolder
fileName = userObjectFolder + 'Alpaca'
'''
fileName = r'C:\GitHub\Alpaca4d\PythonScript\function'
sys.path.append(fileName)

def gradientJet2(value, valueMax, valueMin):

    listcolo = [ rs.CreateColor( 0, 0, 102 ),
                rs.CreateColor( 0, 0, 255 ),
                rs.CreateColor( 0, 64, 255 ),
                rs.CreateColor( 0, 128, 255 ),
                rs.CreateColor( 0, 191, 255 ),
                rs.CreateColor( 0, 255, 255 ),
                rs.CreateColor( 0, 255, 191 ),
                rs.CreateColor( 0, 255, 128 ),
                rs.CreateColor( 0, 255, 64 ),
                rs.CreateColor( 0, 255, 0 ),
                rs.CreateColor( 64, 255, 0 ),
                rs.CreateColor( 128, 255, 0 ),
                rs.CreateColor( 191, 255, 0 ),
                rs.CreateColor( 255, 255, 0 ),
                rs.CreateColor( 255, 191, 0 ),
                rs.CreateColor( 255, 128, 0 ),
                rs.CreateColor( 255, 64, 0 ),
                rs.CreateColor( 255, 0, 0 ),
                rs.CreateColor( 230, 0, 0 ),
                rs.CreateColor( 204, 0, 0 )]

    #domain = linspace( valueMin,  valueMax, len( listcolo ) )
    n = len( listcolo )
    diff = (float(valueMax) - valueMin)/( n - 1 )
    domain = [diff * i + valueMin  for i in range(n)]
    return [ listcolo, domain ]


colorList = gradientJet2( value, max, min )
color = colorList[0]  #.reverse()
color.reverse()
tag = []
tag.append( str(round(colorList[1][0],2) ) )
for i in range(1,len(colorList[1])):
    tag.append( str(round(colorList[1][i-1],2)) + '< valor < ' + str(round(colorList[1][i],2)) )
domain = colorList[1]
tag.reverse()
# ---------- end ghpython_script ----------
curve_direction_2 = GhPythonScript(Crv=flatten(shatter), Thickness=Slider(3, range=0..10), RGB=explode_tree_8.Branch2)  # -> out; inputs Crv: list of Curve, RGB: list of Color; same code as curve_direction
lng_2 = ListLength(List=ghpython_script.domain)
planesrf = PlaneSurface(Plane=PlaneXY(0, 0, 0), XSize=Slider(40, range=0..100), YSize=Slider(2, range=0..10))
divide = DivideDomain²(Domain=planesrf, UCount=lng_2, VCount=1)
subsrf = Isotrim(Surface=planesrf, Domain=divide)
mcol = MeshColours(Mesh=graft(subsrf), Colours=graft(ghpython_script.color))
mjoin = MeshJoin(Meshes=flatten(mcol))
pt_3 = ConstructPoint(XCoordinate=number_slider_8, YCoordinate=number_slider_7, ZCoordinate=0)
M = Mesh(mjoin)
render_mesh_to_screen = RenderMeshToScreen(Mesh=mjoin, Location=pt_3, ScaleFactor=number_slider_6, Depth=0.95, Fixed=True, m_scWithvp=False)

# ---- group: Legend Display
number_slider_10 = Slider(10, range=0..10)
number_slider_11 = Slider(35, range=0..1000)
number_slider_12 = Slider(655, range=0..1000)

number_slider_13 = Slider(10, range=0..10)
number_slider_14 = Slider(35, range=0..1000)
number_slider_15 = Slider(655, range=0..1000)

# ----
# we can skip some data point. We don't need to read all of them. This can help to make it faster.
# 
# OR
# 
# We can read ALL the files and show only some output.
number_of_line_to_skip = Slider(10, range=1..100)
list_9 = ValueList({"tx": 0, "ty": 1, "tz": 2}, selected="ty")
ghpython_script_2 = GhPythonScript(
    Code=file_7,
    OpenSeesOutputWrapper=analyze.OpenSeesOutputWrapper,
    Speed=number_of_line_to_skip,
    Animate=Toggle(False),
    Reset=Button(),
    Scale=Slider(361, range=0..1000),
    Direction=list_9,
    ModelExstrud=Toggle(False))  # -> Out, ModelDisp, ModelCurve, Max_min, Disp
list_item_2 = ListItem(List=ghpython_script_2.Max_min, Index=0, Wrap=True)  # -> Item, Item1
modeldisp_2 = ModelDisp(ghpython_script_2.ModelDisp)
max_min_2 = Max_min(ghpython_script_2.Max_min)
explode_tree_9 = ExplodeTree(Data=ghpython_script_2.ModelCurve)  # -> Branch0, Branch1, Branch2
construct_domain_2 = ConstructDomain(DomainStart=list_item_2.Item1, DomainEnd=list_item_2.Item)
divide_curve_2 = DivideCurve(Curve=explode_tree_9.Branch0, Count=explode_tree_9.Branch1, Kinks=False)  # -> Points, Tangents, simplify(Parameters)
dedomain_2 = DeconstructDomain(Domain=construct_domain_2)  # -> Start, End
shatter_2 = Shatter(Curve=graft(explode_tree_9.Branch0), Parameters=divide_curve_2.Parameters)  # -> simplify(Segments)
ghpython_script_3 = GhPythonScript(max=dedomain_2.End, min=dedomain_2.Start)  # -> out, color, tag, domain; same code as ghpython_script
curve_direction_3 = GhPythonScript(Crv=flatten(shatter_2), Thickness=Slider(3, range=0..10), RGB=explode_tree_9.Branch2)  # -> out; inputs Crv: list of Curve, RGB: list of Color; same code as curve_direction
lng_3 = ListLength(List=ghpython_script_3.domain)
planesrf_2 = PlaneSurface(Plane=PlaneXY(0, 0, 0), XSize=Slider(40, range=0..100), YSize=Slider(2, range=0..10))
divide_2 = DivideDomain²(Domain=planesrf_2, UCount=lng_3, VCount=1)
subsrf_2 = Isotrim(Surface=planesrf_2, Domain=divide_2)
mcol_2 = MeshColours(Mesh=graft(subsrf_2), Colours=graft(ghpython_script_3.color))
mjoin_2 = MeshJoin(Meshes=flatten(mcol_2))
pt_4 = ConstructPoint(XCoordinate=number_slider_15, YCoordinate=number_slider_14, ZCoordinate=0)
M_2 = Mesh(mjoin_2)
render_mesh_to_screen_2 = RenderMeshToScreen(Mesh=mjoin_2, Location=pt_4, ScaleFactor=number_slider_13, Depth=0.95, Fixed=True, m_scWithvp=False)

list_item_3 = ListItem(List=ghpython_script_2.Max_min, Index=0, Wrap=True)
rec = DataRecorder(list_item_3, DataLimit=-10, RecordData=True)
graph_2 = QuickGraph(rec, SortOrder=0)

# ----
# Modal Animate
number_slider_16 = Slider(2, range=0..10)
path_8 = FilePath("C:\GitHub\Alpaca4d\PythonScript\Post-Processing\animateModal\animateModal.py")
list_10 = ValueList({"tx": 0, "ty": 1, "tz": 2}, selected="tx")
file_8 = ReadFile(File=path_8, PerLineParse=False)
planesrf_3 = PlaneSurface(Plane=PlaneXY(0, 0, 0), XSize=Slider(40, range=0..100), YSize=Slider(2, range=0..10))
pt_5 = ConstructPoint(XCoordinate=number_slider_12, YCoordinate=number_slider_11, ZCoordinate=0)

# ---- group: MODAL ANALYSIS
ghpython_script_4 = GhPythonScript(
    Code=file_8,
    OpenSeesOutputWrapper=analyze_2.OpenSeesOutputWrapper,
    NumberMode=Slider(2, range=0..10),
    Speed=Slider(1, range=1..20),
    Animate=Toggle(False),
    Reset=Button(),
    Scale=number_slider_16,
    Direction=list_10,
    ModelExstrud=Toggle(True))  # -> Out, ModelDisp, ModelCurve, Max_min

# ----
list_item_4 = ListItem(List=ghpython_script_4.Max_min, Index=0, Wrap=True)  # -> Item, Item1
modeldisp_3 = ModelDisp(ghpython_script_4.ModelDisp)
max_min_3 = Max_min(ghpython_script_4.Max_min)
explode_tree_10 = ExplodeTree(Data=ghpython_script_4.ModelCurve)  # -> Branch0, Branch1, Branch2
construct_domain_3 = ConstructDomain(DomainStart=list_item_4.Item1, DomainEnd=list_item_4.Item)
divide_curve_3 = DivideCurve(Curve=explode_tree_10.Branch0, Count=explode_tree_10.Branch1, Kinks=False)  # -> Points, Tangents, simplify(Parameters)
dedomain_3 = DeconstructDomain(Domain=construct_domain_3)  # -> Start, End
shatter_3 = Shatter(Curve=graft(explode_tree_10.Branch0), Parameters=divide_curve_3.Parameters)  # -> simplify(Segments)
ghpython_script_5 = GhPythonScript(max=dedomain_3.End, min=dedomain_3.Start)  # -> out, color, tag, domain; same code as ghpython_script
curve_direction_4 = GhPythonScript(Crv=flatten(shatter_3), Thickness=Slider(3, range=0..10), RGB=explode_tree_10.Branch2)  # -> out; inputs Crv: list of Curve, RGB: list of Color; same code as curve_direction
lng_4 = ListLength(List=ghpython_script_5.domain)
divide_3 = DivideDomain²(Domain=planesrf_3, UCount=lng_4, VCount=1)
subsrf_3 = Isotrim(Surface=planesrf_3, Domain=divide_3)
mcol_3 = MeshColours(Mesh=graft(subsrf_3), Colours=graft(ghpython_script_5.color))
mjoin_3 = MeshJoin(Meshes=flatten(mcol_3))
M_3 = Mesh(mjoin_3)
render_mesh_to_screen_3 = RenderMeshToScreen(Mesh=mjoin_3, Location=pt_5, ScaleFactor=number_slider_10, Depth=0.95, Fixed=True, m_scWithvp=False)
